# Dynamo graph 01-Intro.dyn (Dynamo 4.1.2.5356)
# packages: AMR Sheet Set Manager 0.3.14

code_block = CodeBlock { true; }
# note: This node is for creating a new Database. Provide the filename to save to, and an optional template .dst file. The alwaysCreate flag will allow you to overwrite an existing .dst file.
createDatabase = AMR.dynSSetMgr.SheetSetMgr.CreateDatabase(alwaysCreate=code_block)  # unwired: sheetSetMgr, filename
code_block_2 = CodeBlock()
# ---------- code_block_2.designscript (3 lines) ----------
// this is a sample sheet set that ships with AutoCAD
// you can select your own file instead
"C:\\Program Files\\Autodesk\\AutoCAD 2021\\Sample\\Sheet Sets\\Civil\\Civil Sample Sheet Set.dst";
# ----------------------------------------
# note: If you know the file name of a Database, and you want to get it from the currently open Databases, you can use this node.
findOpenDatabase = AMR.dynSSetMgr.SheetSetMgr.FindOpenDatabase(filename=code_block_2)  # unwired: sheetSetMgr
# note: This node will open an existing Database. It does the same thing as the above node but if the Database is already open, the Sheet Set Manager can provide an error, which can be overridden with the bFailIfAlreadyOpen option.
# This Add-On has made that option default to false, so a Database will always be returned.
openDatabase = AMR.dynSSetMgr.SheetSetMgr.OpenDatabase(filename=code_block_2)  # unwired: sheetSetMgr
# note: The SheetSetMgr node is the key to accessing the Sheet Set data.
# It is suggested that while working with the Sheet Set Manager Add-on, you have the Sheet Set Palette open so that you can observe your changes. You may also need to manually run the graphs as they develop in complexity.
sheetSetManager = AMR.dynSSetMgr.SheetSetMgr.SheetSetManager()
# note: This node will return all of the open Databases in the Sheet Set Manager palette.
databases = AMR.dynSSetMgr.SheetSetMgr.Databases(sheetSetMgr=sheetSetManager)
code_block_3 = CodeBlock { true; }
closeAll = AMR.dynSSetMgr.SheetSetMgr.CloseAll(doIt=code_block_3)  # unwired: sheetSetMgr
# note: A Database is the actual .dst file. It stores all of the data. You can directly access a Database by providing the SheetSetMgr object and a file name.
# Many times it is simpler to use the SheetSetMgr functions to access an existing Database.
byFilename = AMR.dynSSetMgr.Database.ByFilename(filename=code_block_2)  # unwired: sheetSetManager
# note: These nodes are used to close a database file.
# Due to a limitation of the original API, closing a Database does not get reflected in the Sheet Set Manager palette.
# These should only be used carefully.
close = AMR.dynSSetMgr.SheetSetMgr.Close(database=byFilename)  # unwired: sheetSetMgr
