# Dynamo graph 02-Working with the Sheet Set.dyn (Dynamo 4.1.2.5356)
# packages: AMR Sheet Set Manager 0.3.14

sheetSetManager = AMR.dynSSetMgr.SheetSetMgr.SheetSetManager()
code_block = CodeBlock()
# ---------- code_block.designscript (3 lines) ----------
// this is a sample sheet set that ships with AutoCAD
// you can select your own file instead
"C:\\Program Files\\Autodesk\\AutoCAD 2025\\Sample\\Sheet Sets\\Civil\\Civil Sample Sheet Set.dst";
# ----------------------------------------
byFilename = AMR.dynSSetMgr.Database.ByFilename(sheetSetManager=sheetSetManager, filename=code_block)
# note: Once you have the Database, you can access the content of the file.
# This content is known as the Sheet Set.
byDatabase = AMR.dynSSetMgr.SheetSet.ByDatabase(database=byFilename)
# note: You can access any of the built-in properties of the Sheet Set.
name = AMR.dynSSetMgr.SheetSet.Name(sheetSet=byDatabase)
description = AMR.dynSSetMgr.SheetSet.Description(sheetSet=byDatabase)
projectName = AMR.dynSSetMgr.SheetSet.ProjectName(sheetSet=byDatabase)
projectNumber = AMR.dynSSetMgr.SheetSet.ProjectNumber(sheetSet=byDatabase)
projectPhase = AMR.dynSSetMgr.SheetSet.ProjectPhase(sheetSet=byDatabase)
promptForTemplate = AMR.dynSSetMgr.SheetSet.PromptForTemplate(sheetSet=byDatabase)
projectMilestone = AMR.dynSSetMgr.SheetSet.ProjectMilestone(sheetSet=byDatabase)
# note: You can also set any of the built-in property values.
# Connect the Database.ByFilename output port to the SheetSet.ByDatabase input port to apply these changes.
# If the return values are null, the changes were not able to be made. The sheet set file being opened in this example is a sample file included with AutoCAD and may not be accessible.
byDatabase_2 = AMR.dynSSetMgr.SheetSet.ByDatabase()  # unwired: database
code_block_2 = CodeBlock { "New Sheet Set Name"; "New Description"; "New Project Name"; "New Project Number"; "New Phase"; "New Milestone"; true; }
setDescription = AMR.dynSSetMgr.SheetSet.SetDescription(sheetSet=byDatabase_2, value=code_block_2.out1)
setName = AMR.dynSSetMgr.SheetSet.SetName(sheetSet=byDatabase_2, value=code_block_2.out0)
setProjectPhase = AMR.dynSSetMgr.SheetSet.SetProjectPhase(sheetSet=byDatabase_2, value=code_block_2.out4)
setProjectNumber = AMR.dynSSetMgr.SheetSet.SetProjectNumber(sheetSet=byDatabase_2, value=code_block_2.out3)
setProjectName = AMR.dynSSetMgr.SheetSet.SetProjectName(sheetSet=byDatabase_2, value=code_block_2.out2)
setPromptForTemplate = AMR.dynSSetMgr.SheetSet.SetPromptForTemplate(sheetSet=byDatabase_2, prompt=code_block_2.out6)
sheetSetManager_2 = AMR.dynSSetMgr.SheetSetMgr.SheetSetManager()
code_block_3 = CodeBlock()  # same code as code_block
byFilename_2 = AMR.dynSSetMgr.Database.ByFilename(sheetSetManager=sheetSetManager_2, filename=code_block_3)
setProjectMilestone = AMR.dynSSetMgr.SheetSet.SetProjectMilestone(sheetSet=byDatabase_2, value=code_block_2.out5)
sheetSetManager_3 = AMR.dynSSetMgr.SheetSetMgr.SheetSetManager()
code_block_4 = CodeBlock()  # same code as code_block
byFilename_3 = AMR.dynSSetMgr.Database.ByFilename(sheetSetManager=sheetSetManager_3, filename=code_block_4)
# note: Object collections
# There are many sub-objects to the Sheet Set.
# See the appropriate samples for handling these types of objects.
byDatabase_3 = AMR.dynSSetMgr.SheetSet.ByDatabase(database=byFilename_3)
sheets = AMR.dynSSetMgr.SheetSet.Sheets(sheetSet=byDatabase_3)
subsets = AMR.dynSSetMgr.SheetSet.Subsets(sheetSet=byDatabase_3)
sheetSetManager_4 = AMR.dynSSetMgr.SheetSetMgr.SheetSetManager()
code_block_5 = CodeBlock()  # same code as code_block
byFilename_4 = AMR.dynSSetMgr.Database.ByFilename(sheetSetManager=sheetSetManager_4, filename=code_block_5)
byDatabase_4 = AMR.dynSSetMgr.SheetSet.ByDatabase(database=byFilename_4)
# note: These nodes are for viewing and editing the Sheet View Callout Blocks.
# A Callout Block is defined by a full path and filename, and an optional block name. If a block name is not provided, the file is assumed to be the block.
calloutBlocks = AMR.dynSSetMgr.SheetSet.CalloutBlocks(sheetSet=byDatabase_4)
customProperties = AMR.dynSSetMgr.SheetSet.CustomProperties(sheetSet=byDatabase_3)
sheetSelectionSets = AMR.dynSSetMgr.SheetSet.SheetSelectionSets(sheetSet=byDatabase_3)
byDatabase_5 = AMR.dynSSetMgr.SheetSet.ByDatabase(database=byFilename_4)
modelViews = AMR.dynSSetMgr.SheetSet.ModelViews(sheetSet=byDatabase_5)
labelBlock = AMR.dynSSetMgr.SheetSet.LabelBlock(sheetSet=byDatabase_4)
# note: These nodes are for viewing or editing the location that new Sheets will be saved to when created.
newSheetLocation = AMR.dynSSetMgr.SheetSet.NewSheetLocation(sheetSet=byDatabase_4)
setNewSheetLocation = AMR.dynSSetMgr.SheetSet.SetNewSheetLocation(sheetSet=byDatabase_4, folderName=newSheetLocation)
# note: These nodes are for viewing or editing the Sheet View Label Block.
# A Label Block is defined by a full path and filename, and an optional block name. If a block name is not provided, the file is assumed to be the block.
setLabelBlock = AMR.dynSSetMgr.SheetSet.SetLabelBlock(sheetSet=byDatabase_4)  # unwired: fileName
byDatabase_6 = AMR.dynSSetMgr.SheetSet.ByDatabase(database=byFilename_4)
# note: These nodes allow you to view or change the template and layout that will be used to create new sheets.
newSheetTemplateFilename = AMR.dynSSetMgr.SheetSet.NewSheetTemplateFilename(sheetSet=byDatabase_6)
newSheetTemplateLayout = AMR.dynSSetMgr.SheetSet.NewSheetTemplateLayout(sheetSet=byDatabase_6)
setNewSheetTemplate = AMR.dynSSetMgr.SheetSet.SetNewSheetTemplate(sheetSet=byDatabase_6, templatePath=newSheetTemplateFilename, layoutName=newSheetTemplateLayout)
# note: These nodes are for viewing or editing the Page Setup Overrides file.
pageSetupOverridesFile = AMR.dynSSetMgr.SheetSet.PageSetupOverridesFile(sheetSet=byDatabase_5)
setPageSetupOverride = AMR.dynSSetMgr.SheetSet.SetPageSetupOverride(sheetSet=byDatabase_5, filename=pageSetupOverridesFile)
code_block_6 = CodeBlock()
# ---------- code_block_6.designscript (2 lines) ----------
// A full path to a folder is required
"C:\\Program Files";
# ----------------------------------------
# note: These nodes are for viewing or editing the list of Model View locations.
addModelView = AMR.dynSSetMgr.SheetSet.AddModelView(sheetSet=byDatabase_5, filepath=code_block_6)
removeModelView = AMR.dynSSetMgr.SheetSet.RemoveModelView(sheetSet=byDatabase_5, filepath=code_block_6)
addCalloutBlock = AMR.dynSSetMgr.SheetSet.AddCalloutBlock()  # unwired: sheetSet, fileName
removeCalloutBlock = AMR.dynSSetMgr.SheetSet.RemoveCalloutBlock()  # unwired: sheetSet, fileName
