# Dynamo graph 03-Working with SubSets.dyn (Dynamo 4.1.2.5356)
# packages: AMR Sheet Set Manager 0.3.0, AMR Sheet Set Manager 0.3.14

# group: Adding a Subset to the Sheet Set
code_block = CodeBlock { "subset1"; "A test subset"; }
createNewSubset = AMR.dynSSetMgr.SubSet.CreateNewSubset(name=code_block.out0, description=code_block.out1)  # unwired: sheetSet
# note: A SubSet is a smaller collection of Sheets within the Sheet Set. SubSets can have their own properties for how a Sheet is created.
# This group demonstrates creating a new SubSet using the Sheet Set defaults.
# To assign new values to the SubSet upon creation, provide the appropriate values to the SubSet.CreateNewSubset input ports.
name = AMR.dynSSetMgr.SubSet.Name(subSet=createNewSubset)
newSheetLocation = AMR.dynSSetMgr.SubSet.NewSheetLocation(subSet=createNewSubset)
description = AMR.dynSSetMgr.SubSet.Description(subSet=createNewSubset)
newSheetTemplate = AMR.dynSSetMgr.SubSet.NewSheetTemplate(subSet=createNewSubset)
promptForTemplate = AMR.dynSSetMgr.SubSet.PromptForTemplate(subSet=createNewSubset)

# group: Adding and Editing a SubSet
code_block_2 = CodeBlock { "Subset 1"; }
# note: This group demonstrates how to modify the settings after the SubSet has been created.
createNewSubset_2 = AMR.dynSSetMgr.SubSet.CreateNewSubset(name=code_block_2, description=code_block_2)  # unwired: sheetSet
code_block_3 = CodeBlock { "C:\\Your\\Template\\Here.dwt"; "Layout Name"; "C:\\New\\Location\\Here"; "NewSubsetName"; }
setName = AMR.dynSSetMgr.SubSet.SetName(subSet=createNewSubset_2, newName=code_block_3.out3)
setNewSheetTemplate = AMR.dynSSetMgr.SubSet.SetNewSheetTemplate(subSet=createNewSubset_2, newSheetDWTLocation=code_block_3.out0, newSheetDWTLayout=code_block_3.out1)
setNewSheetLocation = AMR.dynSSetMgr.SubSet.SetNewSheetLocation(subSet=createNewSubset_2, filePath=code_block_3.out2)

# group: Move Sheet to SubSet Before/After
code_block_4 = CodeBlock { 0; 2; }
bySheetSetIndex = AMR.dynSSetMgr.SubSet.BySheetSetIndex(index=code_block_4.out0)  # unwired: sheetSet
# note: This group demonstrates how to move a Sheet to the SubSet either Before or After another Sheet.
bySheetSetIndex_2 = AMR.dynSSetMgr.Sheet.BySheetSetIndex(index=code_block_4.out1)  # unwired: sheetSet
sheets = AMR.dynSSetMgr.SubSet.Sheets(subSet=bySheetSetIndex)
firstItem = List.FirstItem(list=sheets)
moveSheet = AMR.dynSSetMgr.SubSet.MoveSheet(subSet=bySheetSetIndex, sheet=bySheetSetIndex_2, indexSheet=firstItem)
moveSheetAfter = AMR.dynSSetMgr.SubSet.MoveSheetAfter(subSet=bySheetSetIndex, sheet=bySheetSetIndex_2, indexSheet=firstItem)

sheetSetManager = AMR.dynSSetMgr.SheetSetMgr.SheetSetManager()
databases = AMR.dynSSetMgr.SheetSetMgr.Databases(sheetSetMgr=sheetSetManager)
byDatabase = AMR.dynSSetMgr.SheetSet.ByDatabase(database=databases)
sheetSetManager_2 = AMR.dynSSetMgr.SheetSetMgr.SheetSetManager()
databases_2 = AMR.dynSSetMgr.SheetSetMgr.Databases(sheetSetMgr=sheetSetManager_2)
byDatabase_2 = AMR.dynSSetMgr.SheetSet.ByDatabase(database=databases_2)
sheetSetManager_3 = AMR.dynSSetMgr.SheetSetMgr.SheetSetManager()
databases_3 = AMR.dynSSetMgr.SheetSetMgr.Databases(sheetSetMgr=sheetSetManager_3)
byDatabase_3 = AMR.dynSSetMgr.SheetSet.ByDatabase(database=databases_3)
