# Dynamo graph 04-Working with Sheets.dyn (Dynamo 4.1.2.5356)
# packages: AMR Sheet Set Manager 0.3.0, AMR Sheet Set Manager 0.3.14

# group: Adding new Sheets to Sheet Set
byDatabase = AMR.dynSSetMgr.SheetSet.ByDatabase()  # unwired: database
code_block = CodeBlock { "01"; "first sheet"; }
# note: This group of nodes shows how to add a single sheet to the Sheet Set.
# A Sheet can be added at the beginning of the list of Sheets, After another Sheet or Before another Sheet.
addToSheetSet = AMR.dynSSetMgr.Sheet.AddToSheetSet(sheetSet=byDatabase, filename=code_block.out1, desc=code_block.out1)
setNumber = AMR.dynSSetMgr.Sheet.SetNumber(sheet=addToSheetSet, number=code_block.out0)
setTitle = AMR.dynSSetMgr.Sheet.SetTitle(sheet=addToSheetSet, title=code_block.out1)
code_block_2 = CodeBlock { "03"; "sheet after"; }
addToSheetSetAfter = AMR.dynSSetMgr.Sheet.AddToSheetSetAfter(sheetSet=byDatabase, filename=code_block_2.out1, indexSheet=addToSheetSet, desc=code_block_2.out1)
setTitle_2 = AMR.dynSSetMgr.Sheet.SetTitle(sheet=addToSheetSetAfter, title=code_block_2.out1)
setNumber_2 = AMR.dynSSetMgr.Sheet.SetNumber(sheet=addToSheetSetAfter, number=code_block_2.out0)
code_block_3 = CodeBlock { "02"; "sheet before"; }
addToSheetSetBefore = AMR.dynSSetMgr.Sheet.AddToSheetSetBefore(sheetSet=byDatabase, filename=code_block_3.out1, indexSheet=addToSheetSetAfter, desc=code_block_3.out1)
setTitle_3 = AMR.dynSSetMgr.Sheet.SetTitle(sheet=addToSheetSetBefore, title=code_block_3.out1)
setNumber_3 = AMR.dynSSetMgr.Sheet.SetNumber(sheet=addToSheetSetBefore, number=code_block_3.out0)

# group: Importing Sheets to Sheet Set
byDatabase_2 = AMR.dynSSetMgr.SheetSet.ByDatabase()  # unwired: database
code_block_4 = CodeBlock()
# ---------- code_block_4.designscript (5 lines) ----------
// A full path to the .dwg file is needed
"C:\\Autodesk\\File Name.dwg";
 // replace this line
"Layout Name";
 // replace this line
# ----------------------------------------
# note: This group demonstrates how to import an existing Sheet into the Sheet Set.
# You can import a Sheet at the beginning of a Sheet Set, Before a Sheet or After a Sheet in the Sheet Set.
importLayoutToSheetSet = AMR.dynSSetMgr.Sheet.ImportLayoutToSheetSet(sheetSet=byDatabase_2, filename=code_block_4.out1, layoutName=code_block_4.out0)
name = AMR.dynSSetMgr.Sheet.Name(sheet=importLayoutToSheetSet)
code_block_5 = CodeBlock()
# ---------- code_block_5.designscript (4 lines) ----------
"C:\\Autodesk\\File Name.dwg";
// replace this line
"Layout Name";
// replace this line
# ----------------------------------------
code_block_6 = CodeBlock()  # same code as code_block_5
importLayoutToSheetSetAfter = AMR.dynSSetMgr.Sheet.ImportLayoutToSheetSetAfter(sheetSet=byDatabase_2, filename=code_block_6.out0, layoutName=code_block_6.out1, indexSheet=importLayoutToSheetSet)
importLayoutToSheetSetBefore = AMR.dynSSetMgr.Sheet.ImportLayoutToSheetSetBefore(sheetSet=byDatabase_2, filename=code_block_5.out0, layoutName=code_block_5.out1, indexSheet=importLayoutToSheetSetAfter)
name_2 = AMR.dynSSetMgr.Sheet.Name(sheet=importLayoutToSheetSetBefore)
name_3 = AMR.dynSSetMgr.Sheet.Name(sheet=importLayoutToSheetSetAfter)

# group: Importing Sheets to SubSet
byDatabase_3 = AMR.dynSSetMgr.SheetSet.ByDatabase()  # unwired: database
code_block_7 = CodeBlock { "Subset Name"; }
# note: This group demonstrates how to import an existing Sheet into a SubSet.
# You can import a Sheet at the beginning of a SubSet, Before a Sheet or After a Sheet in the SubSet.
createNewSubset = AMR.dynSSetMgr.SubSet.CreateNewSubset(sheetSet=byDatabase_3, name=code_block_7)
code_block_8 = CodeBlock()
# ---------- code_block_8.designscript (4 lines) ----------
"C:\\Autodesk\\File Name.dwg";
// replace this line
"sheet before";
// replace this line
# ----------------------------------------
code_block_9 = CodeBlock()
# ---------- code_block_9.designscript (4 lines) ----------
"C:\\Autodesk\\File Name.dwg";
// replace this line
"sheet after";
// replace this line
# ----------------------------------------
code_block_10 = CodeBlock()
# ---------- code_block_10.designscript (4 lines) ----------
"C:\\Autodesk\\File Name.dwg";
// replace this line
"first sheet";
// replace this line
# ----------------------------------------
importLayoutToSubSet = AMR.dynSSetMgr.Sheet.ImportLayoutToSubSet(subset=createNewSubset, filename=code_block_10.out0, layoutName=code_block_10.out1)
importLayoutToSubSetAfter = AMR.dynSSetMgr.Sheet.ImportLayoutToSubSetAfter(subset=createNewSubset, filename=code_block_9.out0, layoutName=code_block_9.out1, indexSheet=importLayoutToSubSet)
importLayoutToSubSetBefore = AMR.dynSSetMgr.Sheet.ImportLayoutToSubSetBefore(subset=createNewSubset, filename=code_block_8.out0, layoutName=code_block_8.out1, indexSheet=importLayoutToSubSetAfter)

sheetSetManager = AMR.dynSSetMgr.SheetSetMgr.SheetSetManager()
databases = AMR.dynSSetMgr.SheetSetMgr.Databases(sheetSetMgr=sheetSetManager)
sheetSetManager_2 = AMR.dynSSetMgr.SheetSetMgr.SheetSetManager()
databases_2 = AMR.dynSSetMgr.SheetSetMgr.Databases(sheetSetMgr=sheetSetManager_2)
sheetSetManager_3 = AMR.dynSSetMgr.SheetSetMgr.SheetSetManager()
databases_3 = AMR.dynSSetMgr.SheetSetMgr.Databases(sheetSetMgr=sheetSetManager_3)
