# Dynamo graph 05-Working with Custom Properties.dyn (Dynamo 4.1.2.5356)
# packages: AMR Sheet Set Manager 0.3.0, AMR Sheet Set Manager 0.3.14, AMR Sheet Set Manager 0.3.17

sheetSetManager = AMR.dynSSetMgr.SheetSetMgr.SheetSetManager()
databases = AMR.dynSSetMgr.SheetSetMgr.Databases(sheetSetMgr=sheetSetManager)
byDatabase = AMR.dynSSetMgr.SheetSet.ByDatabase(database=databases)
sheetSetManager_2 = AMR.dynSSetMgr.SheetSetMgr.SheetSetManager()
databases_2 = AMR.dynSSetMgr.SheetSetMgr.Databases(sheetSetMgr=sheetSetManager_2)

# group: Add Custom Property to Sheet Set as Sheet Set Property
code_block = CodeBlock { "TestProp"; "[TestProp]"; }
byNameValue = AMR.dynSSetMgr.CustomProperty.ByNameValue(propName=code_block.out0, propValue=code_block.out1)
# note: This group demonstrates how to Add a new Custom Property as a Sheet Set Property.
addAsSheetSetProperty = AMR.dynSSetMgr.CustomProperty.AddAsSheetSetProperty(customProperty=byNameValue)  # unwired: sheetSet
properties = AMR.dynSSetMgr.CustomProperty.Properties(customProperty=addAsSheetSetProperty)
type = AMR.dynSSetMgr.CustomProperty.Type(customProperty=addAsSheetSetProperty)

# group: Add Custom Property to Sheet Set as Sheet Property
code_block_2 = CodeBlock { "TestProp"; "[TestProp]"; }
byNameValue_2 = AMR.dynSSetMgr.CustomProperty.ByNameValue(propName=code_block_2.out0, propValue=code_block_2.out1)
# note: This group demonstrates how to Add a new Custom Property as a Sheet Property.
addAsSheetProperty = AMR.dynSSetMgr.CustomProperty.AddAsSheetProperty(customProperty=byNameValue_2)  # unwired: sheetSet
properties_2 = AMR.dynSSetMgr.CustomProperty.Properties(customProperty=addAsSheetProperty)
type_2 = AMR.dynSSetMgr.CustomProperty.Type(customProperty=addAsSheetProperty)

# group: Edit Sheet Set Custom Property
code_block_3 = CodeBlock { "SHEET_SET_CUSTOM"; "[SHEET_SET_CUSTOM]"; }
byNameValue_3 = AMR.dynSSetMgr.CustomProperty.ByNameValue(propName=code_block_3.out0, propValue=code_block_3.out1)
code_block_4 = CodeBlock { "New Value"; }
# note: This group demonstrates how to Add or Edit a Custom Property for the Sheet Set.
editValue = AMR.dynSSetMgr.CustomProperty.EditValue(customProperty=byNameValue_3, value=code_block_4)  # unwired: sheetSet
properties_3 = AMR.dynSSetMgr.CustomProperty.Properties(customProperty=editValue)

# group: Edit Custom Property on a Sheet
code_block_5 = CodeBlock { "SHEET_CUSTOM"; "[SHEET_CUSTOM]"; }
byNameValue_4 = AMR.dynSSetMgr.CustomProperty.ByNameValue(propName=code_block_5.out0, propValue=code_block_5.out1)
code_block_6 = CodeBlock { "New Value"; }
# note: This group demonstrates how to Add or Edit a Custom Property for a specific Sheet.
editSheetValue = AMR.dynSSetMgr.CustomProperty.EditSheetValue(customProperty=byNameValue_4, value=code_block_6)  # unwired: sheetSet, sheet
properties_4 = AMR.dynSSetMgr.CustomProperty.Properties(customProperty=editSheetValue)

# group: Edit a Sheet Count Custom Property
code_block_7 = CodeBlock { "COUNT"; "[COUNT]"; }
# note: This group demonstrates one of the most common uses for Custom Properties in a Sheet Set.
# Creating and/or editing a Custom Property that tracks the total count of the Sheets in the Sheet Set.
byNameValue_5 = AMR.dynSSetMgr.CustomProperty.ByNameValue(propName=code_block_7.out0, propValue=code_block_7.out1)
byDatabase_2 = AMR.dynSSetMgr.SheetSet.ByDatabase()  # unwired: database
sheets = AMR.dynSSetMgr.SheetSet.Sheets(sheetSet=byDatabase_2)
firstItem = List.FirstItem(list=sheets)
count = List.Count(list=firstItem)
string_from_object = FromObject(obj=count)
editValue_2 = AMR.dynSSetMgr.CustomProperty.EditValue(customProperty=byNameValue_5, sheetSet=byDatabase_2, value=string_from_object)
properties_5 = AMR.dynSSetMgr.CustomProperty.Properties(customProperty=editValue_2)
