# Dynamo graph ssMgr.dyn (Dynamo 2.5.1.7586)
# packages: AMR Sheet Set Manager 2021.3.53

code_block = CodeBlock { "E:\\Programming\\Testing5.dst"; ""; true; }
string = StringInput("G:\My Drive\Programming Projects\Dynamo\NewFile.dwg")
sheetSetManager = AMR.dynSSetMgr.SheetSetMgr.SheetSetManager()
code_block_2 = CodeBlock { "G:\\My Drive\\Programming Projects\\Dynamo\\Testing 1.dst"; false; }
openDatabase = AMR.dynSSetMgr.SheetSetMgr.OpenDatabase(sheetSetMgr=sheetSetManager, filename=code_block_2.out0, bFailIfAlreadyOpen=code_block_2.out1)
byDatabase = AMR.dynSSetMgr.SheetSet.ByDatabase(database=openDatabase)
string_2 = StringInput("Subset 1")
createNewSubset = AMR.dynSSetMgr.SubSet.CreateNewSubset(sheetSet=byDatabase, name=string_2)
string_3 = StringInput("NewFile")
addToSubSet = AMR.dynSSetMgr.Sheet.AddToSubSet(subset=createNewSubset, filename=string_3)
setTitle = AMR.dynSSetMgr.Sheet.SetTitle(sheet=addToSubSet, title=string_3)
