# Dynamo graph test 2.dyn (Dynamo 2.5.2.7915)
# packages: AMR Sheet Set Manager 0.3.0

code_block = CodeBlock { "E:\\Programming\\TestCreate1.dst"; "C:\\_MS-CAD\\C3D\\2021\\Templates\\GT Sheet Set Template.dst"; true; }
code_block_2 = CodeBlock { "testing creating"; }
code_block_3 = CodeBlock { "C:\\Users\\areilly\\Documents\\AutoCAD Sheet Sets\\Testing 2.dst"; }
openDatabase = AMR.dynSSetMgr.SheetSetMgr.OpenDatabase(sheetSetMgr=code_block_3)
createDatabase = AMR.dynSSetMgr.SheetSetMgr.CreateDatabase()  # unwired: sheetSetMgr
databases = AMR.dynSSetMgr.SheetSetMgr.Databases()  # unwired: sheetSetMgr
byDatabase = AMR.dynSSetMgr.SheetSet.ByDatabase(database=databases)
name = AMR.dynSSetMgr.SheetSet.Name(sheetSet=byDatabase)
description = AMR.dynSSetMgr.SheetSet.Description(sheetSet=byDatabase)
sheets = AMR.dynSSetMgr.SheetSet.Sheets(sheetSet=byDatabase)
setName = AMR.dynSSetMgr.SheetSet.SetName()  # unwired: sheetSet, value
subsets = AMR.dynSSetMgr.SheetSet.Subsets(sheetSet=byDatabase)
sheets_2 = AMR.dynSSetMgr.SubSet.Sheets(subSet=subsets)
name_2 = AMR.dynSSetMgr.Database.Name(database=databases)
filename = AMR.dynSSetMgr.Database.Filename(database=databases)

# group: Adding new Sheets to Sheet Set
byDatabase_2 = AMR.dynSSetMgr.SheetSet.ByDatabase()  # unwired: database
code_block_4 = CodeBlock { "01"; "first sheet"; }
addToSheetSet = AMR.dynSSetMgr.Sheet.AddToSheetSet(sheetSet=byDatabase_2, filename=code_block_4.out1, desc=code_block_4.out1)
setNumber = AMR.dynSSetMgr.Sheet.SetNumber(sheet=addToSheetSet, number=code_block_4.out0)
setTitle = AMR.dynSSetMgr.Sheet.SetTitle(sheet=addToSheetSet, title=code_block_4.out1)
code_block_5 = CodeBlock { "03"; "sheet after"; }
addToSheetSetAfter = AMR.dynSSetMgr.Sheet.AddToSheetSetAfter(sheetSet=byDatabase_2, filename=code_block_5.out1, indexSheet=addToSheetSet, desc=code_block_5.out1)
setTitle_2 = AMR.dynSSetMgr.Sheet.SetTitle(sheet=addToSheetSetAfter, title=code_block_5.out1)
setNumber_2 = AMR.dynSSetMgr.Sheet.SetNumber(sheet=addToSheetSetAfter, number=code_block_5.out0)
code_block_6 = CodeBlock { "02"; "sheet before"; }
addToSheetSetBefore = AMR.dynSSetMgr.Sheet.AddToSheetSetBefore(sheetSet=byDatabase_2, filename=code_block_6.out1, indexSheet=addToSheetSetAfter, desc=code_block_6.out1)
setTitle_3 = AMR.dynSSetMgr.Sheet.SetTitle(sheet=addToSheetSetBefore, title=code_block_6.out1)
setNumber_3 = AMR.dynSSetMgr.Sheet.SetNumber(sheet=addToSheetSetBefore, number=code_block_6.out0)

# group: Importing Sheets to Sheet Set
byDatabase_3 = AMR.dynSSetMgr.SheetSet.ByDatabase()  # unwired: database
code_block_7 = CodeBlock { "E:\\Programming\\SHEETS\\first sheet.dwg"; "first sheet"; }
importLayoutToSheetSet = AMR.dynSSetMgr.Sheet.ImportLayoutToSheetSet(sheetSet=byDatabase_3, filename=code_block_7.out0, layoutName=code_block_7.out1)
name_3 = AMR.dynSSetMgr.Sheet.Name(sheet=importLayoutToSheetSet)
code_block_8 = CodeBlock { "E:\\Programming\\SHEETS\\sheet before.dwg"; "sheet before"; }
code_block_9 = CodeBlock { "E:\\Programming\\SHEETS\\sheet after.dwg"; "sheet after"; }
importLayoutToSheetSetAfter = AMR.dynSSetMgr.Sheet.ImportLayoutToSheetSetAfter(sheetSet=byDatabase_3, filename=code_block_9.out0, layoutName=code_block_9.out1, indexSheet=importLayoutToSheetSet)
importLayoutToSheetSetBefore = AMR.dynSSetMgr.Sheet.ImportLayoutToSheetSetBefore(sheetSet=byDatabase_3, filename=code_block_8.out0, layoutName=code_block_8.out1, indexSheet=importLayoutToSheetSetAfter)
name_4 = AMR.dynSSetMgr.Sheet.Name(sheet=importLayoutToSheetSetBefore)
name_5 = AMR.dynSSetMgr.Sheet.Name(sheet=importLayoutToSheetSetAfter)

# group: Importing Sheets to SubSet
byDatabase_4 = AMR.dynSSetMgr.SheetSet.ByDatabase()  # unwired: database
code_block_10 = CodeBlock { "Subset Name"; }
createNewSubset = AMR.dynSSetMgr.SubSet.CreateNewSubset(sheetSet=byDatabase_4, name=code_block_10)
code_block_11 = CodeBlock { "E:\\Programming\\SHEETS\\sheet before.dwg"; "sheet before"; }
code_block_12 = CodeBlock { "E:\\Programming\\SHEETS\\sheet after.dwg"; "sheet after"; }
code_block_13 = CodeBlock { "E:\\Programming\\SHEETS\\first sheet.dwg"; "first sheet"; }
importLayoutToSubSet = AMR.dynSSetMgr.Sheet.ImportLayoutToSubSet(subset=createNewSubset, filename=code_block_13.out0, layoutName=code_block_13.out1)
importLayoutToSubSetAfter = AMR.dynSSetMgr.Sheet.ImportLayoutToSubSetAfter(subset=createNewSubset, filename=code_block_12.out0, layoutName=code_block_12.out1, indexSheet=importLayoutToSubSet)
importLayoutToSubSetBefore = AMR.dynSSetMgr.Sheet.ImportLayoutToSubSetBefore(subset=createNewSubset, filename=code_block_11.out0, layoutName=code_block_11.out1, indexSheet=importLayoutToSubSetAfter)

# group: Add Custom Property to Sheet Set as Sheet Set Property
code_block_14 = CodeBlock { "TestProp"; "[TestProp]"; }
byNameValue = AMR.dynSSetMgr.CustomProperty.ByNameValue(propName=code_block_14.out0, propValue=code_block_14.out1)
addAsSheetSetProperty = AMR.dynSSetMgr.CustomProperty.AddAsSheetSetProperty(customProperty=byNameValue)  # unwired: sheetSet
type = AMR.dynSSetMgr.CustomProperty.Type(customProperty=addAsSheetSetProperty)

# group: Add Custom Property to Sheet Set as Sheet Property
code_block_15 = CodeBlock { "TestProp"; "[TestProp]"; }
byNameValue_2 = AMR.dynSSetMgr.CustomProperty.ByNameValue(propName=code_block_15.out0, propValue=code_block_15.out1)
addAsSheetProperty = AMR.dynSSetMgr.CustomProperty.AddAsSheetProperty(customProperty=byNameValue_2)  # unwired: sheetSet
type_2 = AMR.dynSSetMgr.CustomProperty.Type(customProperty=addAsSheetProperty)

# group: Adding a Subset to the Sheet Set
code_block_16 = CodeBlock { "subset1"; "A test subset"; }
createNewSubset_2 = AMR.dynSSetMgr.SubSet.CreateNewSubset(name=code_block_16.out0, description=code_block_16.out1)  # unwired: sheetSet
name_6 = AMR.dynSSetMgr.SubSet.Name(subSet=createNewSubset_2)
newSheetLocation = AMR.dynSSetMgr.SubSet.NewSheetLocation(subSet=createNewSubset_2)
description_2 = AMR.dynSSetMgr.SubSet.Description(subSet=createNewSubset_2)
newSheetTemplate = AMR.dynSSetMgr.SubSet.NewSheetTemplate(subSet=createNewSubset_2)
promptForTemplate = AMR.dynSSetMgr.SubSet.PromptForTemplate(subSet=createNewSubset_2)

# group: Edit Sheet Set Custom Property
code_block_17 = CodeBlock { "CITY_APP_DATE"; "[CITY_APP_DATE]"; }
byNameValue_3 = AMR.dynSSetMgr.CustomProperty.ByNameValue(propName=code_block_17.out0, propValue=code_block_17.out1)
code_block_18 = CodeBlock { "New Value"; }
editValue = AMR.dynSSetMgr.CustomProperty.EditValue(customProperty=byNameValue_3, value=code_block_18)  # unwired: sheetSet

# group: Edit Custom Property on a Sheet
code_block_19 = CodeBlock { "SHEET_CUSTOM"; "[SHEET_CUSTOM]"; }
byNameValue_4 = AMR.dynSSetMgr.CustomProperty.ByNameValue(propName=code_block_19.out0, propValue=code_block_19.out1)
code_block_20 = CodeBlock { "New Value"; }
editSheetValue = AMR.dynSSetMgr.CustomProperty.EditSheetValue(customProperty=byNameValue_4, value=code_block_20)  # unwired: sheetSet, sheet

# group: Adding and Editing a SubSet
code_block_21 = CodeBlock { "Subset 1"; }
createNewSubset_3 = AMR.dynSSetMgr.SubSet.CreateNewSubset(description=code_block_21)  # unwired: sheetSet, name
code_block_22 = CodeBlock { "C:\\_MS-CAD\\C3D\\2021\\Templates\\GT Office\\SHEET-COVERS.dwt"; "Round Rock"; "E:\\Programming"; "renamed"; }
setName_2 = AMR.dynSSetMgr.SubSet.SetName(subSet=createNewSubset_3, newName=code_block_22.out3)
setNewSheetTemplate = AMR.dynSSetMgr.SubSet.SetNewSheetTemplate(subSet=createNewSubset_3, newSheetDWTLocation=code_block_22.out0, newSheetDWTLayout=code_block_22.out1)
setNewSheetLocation = AMR.dynSSetMgr.SubSet.SetNewSheetLocation(subSet=createNewSubset_3, filePath=code_block_22.out2)

# group: Move Sheet to SubSet Before/After
code_block_23 = CodeBlock { 0; 2; }
bySheetSetIndex = AMR.dynSSetMgr.SubSet.BySheetSetIndex(index=code_block_23.out0)  # unwired: sheetSet
bySheetSetIndex_2 = AMR.dynSSetMgr.Sheet.BySheetSetIndex(index=code_block_23.out1)  # unwired: sheetSet
sheets_3 = AMR.dynSSetMgr.SubSet.Sheets(subSet=bySheetSetIndex)
firstItem = List.FirstItem(list=sheets_3)
moveSheet = AMR.dynSSetMgr.SubSet.MoveSheet(subSet=bySheetSetIndex, sheet=bySheetSetIndex_2, indexSheet=firstItem)
moveSheetAfter = AMR.dynSSetMgr.SubSet.MoveSheetAfter(subSet=bySheetSetIndex, sheet=bySheetSetIndex_2, indexSheet=firstItem)

# group: Edit a Sheet Count Custom Property
code_block_24 = CodeBlock { "SD_COUNT"; "[SD_COUNT]"; }
byNameValue_5 = AMR.dynSSetMgr.CustomProperty.ByNameValue(propName=code_block_24.out0, propValue=code_block_24.out1)
byDatabase_5 = AMR.dynSSetMgr.SheetSet.ByDatabase()  # unwired: database
sheets_4 = AMR.dynSSetMgr.SheetSet.Sheets(sheetSet=byDatabase_5)
firstItem_2 = List.FirstItem(list=sheets_4)
count = List.Count(list=firstItem_2)
string_from_object = FromObject(obj=count)
editValue_2 = AMR.dynSSetMgr.CustomProperty.EditValue(customProperty=byNameValue_5, sheetSet=byDatabase_5, value=string_from_object)

# group: Editing Sheet Selection Sets
sheetSelectionSets = AMR.dynSSetMgr.SheetSet.SheetSelectionSets()  # unwired: sheetSet
name_7 = AMR.dynSSetMgr.SheetSelectionSet.Name(sheetSelectionSet=sheetSelectionSets)
sheets_5 = AMR.dynSSetMgr.SheetSelectionSet.Sheets(sheetSelectionSet=sheetSelectionSets)
code_block_25 = CodeBlock { 4; 20; }
bySheetSetIndex_3 = AMR.dynSSetMgr.Sheet.BySheetSetIndex(index=code_block_25.out0)  # unwired: sheetSet
addSheet = AMR.dynSSetMgr.SheetSelectionSet.AddSheet(sheetSelectionSet=sheetSelectionSets, newSheet=bySheetSetIndex_3)
sheets_6 = AMR.dynSSetMgr.SheetSelectionSet.Sheets(sheetSelectionSet=addSheet)
bySheetSetIndex_4 = AMR.dynSSetMgr.Sheet.BySheetSetIndex(index=code_block_25.out1)  # unwired: sheetSet
removeSheet = AMR.dynSSetMgr.SheetSelectionSet.RemoveSheet(sheetSelectionSet=sheetSelectionSets, removeSheet=bySheetSetIndex_4)
sheets_7 = AMR.dynSSetMgr.SheetSelectionSet.Sheets(sheetSelectionSet=removeSheet)

# group: Adding/Removing Model Space Locations
code_block_26 = CodeBlock { "E:\\"; "D:\\CAD files"; ""; }
removeModelView = AMR.dynSSetMgr.SheetSet.RemoveModelView(filepath=code_block_26.out1)  # unwired: sheetSet
modelViews = AMR.dynSSetMgr.SheetSet.ModelViews(sheetSet=removeModelView)
addModelView = AMR.dynSSetMgr.SheetSet.AddModelView(filepath=code_block_26.out0)  # unwired: sheetSet
modelViews_2 = AMR.dynSSetMgr.SheetSet.ModelViews(sheetSet=addModelView)

# group: Add/Remove Callout Blocks
code_block_27 = CodeBlock { "D:\\CAD files\\Parking Test.dwg"; ""; }
removeCalloutBlock = AMR.dynSSetMgr.SheetSet.RemoveCalloutBlock(fileName=code_block_27.out0, blockName=code_block_27.out1)  # unwired: sheetSet
calloutBlocks = AMR.dynSSetMgr.SheetSet.CalloutBlocks(sheetSet=removeCalloutBlock)
addCalloutBlock = AMR.dynSSetMgr.SheetSet.AddCalloutBlock(fileName=code_block_27.out0, blockName=code_block_27.out1)  # unwired: sheetSet

# group: Set/Get Label Blocks of the Sheet Set
code_block_28 = CodeBlock { "E:\\CAD Stuff\\26357V-TREES.dwg"; }
setLabelBlock = AMR.dynSSetMgr.SheetSet.SetLabelBlock(fileName=code_block_28)  # unwired: sheetSet
labelBlock = AMR.dynSSetMgr.SheetSet.LabelBlock(sheetSet=setLabelBlock)

sheetSetManager = AMR.dynSSetMgr.SheetSetMgr.SheetSetManager()
databases_2 = AMR.dynSSetMgr.SheetSetMgr.Databases(sheetSetMgr=sheetSetManager)
byDatabase_6 = AMR.dynSSetMgr.SheetSet.ByDatabase(database=databases_2)
code_block_29 = CodeBlock { 0; }
bySheetSetIndex_5 = AMR.dynSSetMgr.Sheet.BySheetSetIndex(sheetSet=byDatabase_6, index=code_block_29)
sheetViews = AMR.dynSSetMgr.Sheet.SheetViews(sheet=bySheetSetIndex_5)
name_8 = AMR.dynSSetMgr.SheetView.Name(sheetView=sheetViews)
number = AMR.dynSSetMgr.SheetView.Number(sheetView=sheetViews)
category = AMR.dynSSetMgr.SheetView.Category(sheetView=sheetViews)
